# Grasshopper definition 3D_GraphML_A1_MO_gh.gh (Grasshopper 1.0.8)

staircase_crv = Geometry(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)
gf_rooms_crvs = Geometry([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])
ff_rooms_crvs = Geometry([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])
door_crvs = Geometry([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])
windows_crvs = Geometry([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])
boundary_surfaces = BoundarySurfaces(Edges=gf_rooms_crvs)
boundary_surfaces_2 = BoundarySurfaces(Edges=staircase_crv)
boundary_surfaces_3 = BoundarySurfaces(Edges=ff_rooms_crvs)
boundary_surfaces_4 = BoundarySurfaces(Edges=door_crvs)
boundary_surfaces_5 = BoundarySurfaces(Edges=windows_crvs)
unit_z = UnitZ(Factor=3)
unit_z_2 = UnitZ(Factor=5.8)
move = Move(Geometry=boundary_surfaces_3, Motion=unit_z)  # -> Geometry, Transform
extrude = Extrude(Base=boundary_surfaces_2, Direction=unit_z_2)
extrude_2 = Extrude(Base=boundary_surfaces, Direction=unit_z)
unit_z_3 = UnitZ(Factor=2.8)
extrude_3 = Extrude(Base=move.Geometry, Direction=unit_z_3)

gf_rooms = Data(extrude_2)
staircase = Data(extrude)
windows = Data(boundary_surfaces_5)
ff_rooms = Data(extrude_3)
doors = Data(boundary_surfaces_4)
