# Grasshopper definition crv_clean.gh (Grasshopper 1.0.8)

curve = Curve(<curve referenced from the Rhino model>)
curve_2 = Curve(<curve referenced from the Rhino model>)
panel = Panel(curve)
explode = Explode(Curve=curve_2, Recursive=True)  # -> Segments, Vertices
cull_duplicates = CullDuplicates(Points=explode.Vertices, Tolerance=0.1, CullMode=1)  # -> Points, Indices, Valence
polyline = PolyLine(Vertices=cull_duplicates.Points, Closed=True)
vector_xyz = VectorXYZ(XComponent=0, YComponent=0, ZComponent=30)  # -> Vector, Length
extrude = Extrude(Base=polyline, Direction=vector_xyz.Vector)
cap_holes = CapHoles(Brep=extrude)
